vi "Main.gviweb"   [LabVIEW NXG 2.1.0]
panel controls:
  "StartAcqButton": bool
  "Server URL": string
  "Port": string
panel indicators:
  "Temperature": i32
  "Digital Input Data": bool[]
  "Voltage RMS": i32
  "Frequency": i32
types:
  T1 = cluster{"TemperatureData": i32, "DIData": bool[], "VRMSData": i32, "FreqData": i32}
uses:
  NI::HTTP::GET.gvi
  NI::HTTP::POST Buffer.gvi
diagram:
  # Place setup code before the loop. For example, perform initial data communication and wire the results into the loop.
  # Top-Level WebVIs usually contain a While Loop that never stops so that they can continue running as long as the web page is open in the user's web browser.
  while {
    Concatenate Strings("http://", $"Server URL", ":", $Port, "/WebAPIv1/GetData") -> w1
    call "GET.gvi"(url=w1) -> (body=w2)
    Unflatten From JSON(JSON string=w2, type and defaults=T1 {all zero or empty}) -> (value=w3)
    Property Node(instance in=w3) -> ("TemperatureData"=w4, "DIData"=w5, "VRMSData"=w6, "FreqData"=w7)
    $Temperature <- w4
    $"Digital Input Data" <- w5
    $"Voltage RMS" <- w6
    $Frequency <- w7
    Wait(time to wait=50)
    stop if FALSE
  }
  # Top-Level WebVIs usually contain a While Loop that never stops so that they can continue running as long as the web page is open in the user's web browser.
  while {
    Concatenate Strings("http://", $"Server URL", ":", $Port, "/WebAPIv1/StartAcq") -> w8
    Property Node(instance in=cluster{"StartAcq": bool} {"StartAcq"=TRUE}, "StartAcq"=$StartAcqButton) -> (instance out=w9)
    Flatten To JSON(anything=w9) -> (JSON string=w10)
    call "POST Buffer.gvi"(url=w8, buffer=w10)
    Wait(time to wait=50)
    stop if FALSE
  }
